# Grasshopper definition Layer Chair - by DyvikDesign - Grasshopper defintion.gh (Grasshopper 0.8.66)

inner_curve_blend_vector_variation = Slider(1, range=1..2)
curve_blend_vector_ratio = Slider(0.648, range=0..2)
outer_curve_blend_radius = Slider(1.375, range=0.9..2)
chair_width = Slider(400, range=0..600)
inner_curve_blend_radius = Slider(0.663, range=0..2)
material_thickness = Slider(18, range=0..40)
seat_resolution = Slider(3, range=1..12)
nesting_distance = Slider(725, range=0..2000)
top_curv_blend_ratio = Slider(0.6, range=0..1)
milling_bit_diameter = Slider(3.18, range=0..20)
seat_thickness = Slider(27, range=0..40)
screw_hole_radius = Slider(1.5, range=1..6)
# License:
# Creative Commons
# Attribution-NonCommercial-ShareAlike 3.0 Unported
# (CC BY-NC-SA 3.0)
outer_profile = Curve(<curve referenced from the Rhino model>)
leg_rotation = Slider(2.2, range=0..20)
# Load profile curves here:
mid_profile = Curve(<curve referenced from the Rhino model>)
asym_ratio = Slider(1.6, range=1..4)
feet_fillet = Slider(12, range=0..30)
division = Division(A=chair_width, B=material_thickness)
division_2 = Division(A=material_thickness, B=seat_resolution)
multiplication = Multiplication(A=seat_thickness, B=top_curv_blend_ratio)
division_3 = Division(A=division, B=2)
crv = Curve(mid_profile)
int = Integer(division_3)
multiplication_2 = Multiplication(A=int, B=seat_resolution)
multiplication_3 = Multiplication(A=int, B=material_thickness)
X = UnitX(Factor=multiplication_3)
end = EndPoints(Curve=crv)  # -> Start, End
end_2 = EndPoints(Curve=crv)  # -> Start, End
move = Move(Geometry=outer_profile, Translation=X)  # -> Geometry, Transform
crv_2 = Curve(move.Geometry)
rad = Radians(Degrees=leg_rotation)
crv_cp = CurveCP(Point=end.End, Curve=crv)  # -> Point, Parameter, Distance
rad_2 = Radians(Degrees=leg_rotation)
crv_cp_2 = CurveCP(Point=end_2.Start, Curve=crv)  # -> Point, Parameter, Distance
rad_3 = Radians(Degrees=leg_rotation)
neg = Negative(Input=rad)
neg_2 = Negative(Input=rad_2)
neg_3 = Negative(Input=rad_3)
Y = UnitY(Factor=seat_thickness)
Y_2 = UnitY(Factor=seat_thickness)
Y_3 = UnitY(Factor=seat_thickness)
xy = XYPlane(Origin=Point(0, 0, 0))
xy_2 = XYPlane(Origin=Point(0, 0, 0))
xy_3 = XYPlane(Origin=Point(0, 0, 0))
yz = YZPlane(Origin=Point(0, 0, 0))
series = Series(Start=material_thickness, Step=material_thickness, Count=int)
multiplication_4 = Multiplication(A=seat_thickness, B=outer_curve_blend_radius)
end_3 = EndPoints(Curve=crv_2)  # -> Start, End
cp = PlaneCP(Point=end_3.Start, Plane=xy)  # -> Point, UVPoint, Distance
yz_2 = YZPlane(Origin=cp.Point)
xy_4 = XYPlane(Origin=Point(0, 0, 0))
xy_5 = XYPlane(Origin=Point(0, 0, 0))
multiplication_5 = Multiplication(A=seat_thickness, B=outer_curve_blend_radius)
xy_6 = XYPlane(Origin=Point(0, 0, 0))
multiplication_6 = Multiplication(A=seat_thickness, B=outer_curve_blend_radius)
multiplication_7 = Multiplication(A=multiplication_5, B=asym_ratio)
crv_3 = Curve(crv_2)
multiplication_8 = Multiplication(A=multiplication_6, B=asym_ratio)
multiplication_9 = Multiplication(A=multiplication_4, B=asym_ratio)
yz_3 = YZPlane(Origin=end_3.Start)
mirror = Mirror(Geometry=move.Geometry, Plane=yz)  # -> Geometry, Transform
X_2 = UnitX(Factor=series)
ln = Line(PointA=end_3.Start, PointB=cp.Point)
rotate = Rotate(Geometry=ln, Angle=neg, Plane=yz_2)  # -> Geometry, Transform
move_2 = Move(Geometry=rotate.Geometry, Translation=Y)  # -> Geometry, Transform
cir = Circle(Plane=yz_3, Radius=multiplication_7)
cir_2 = Circle(Plane=yz_3, Radius=multiplication_5)
move_3 = Move(Geometry=yz, Translation=X_2)  # -> Geometry, Transform
loft = Loft(
    Section=[move.Geometry, mid_profile, mirror.Geometry],
    Options={Adjust=False, Closed=False, Rebuild=10, Refit=0.01, LoftType=0, LoftEnds=0, LoftSimp=0})
sec = BrepPlane(Brep=loft, Plane=move_3.Geometry)  # -> Curves, Points
ccx = CurveCurve(CurveA=ln, CurveB=cir)  # -> Points, ParamsA, ParamsB
ccx_2 = CurveCurve(CurveA=crv_2, CurveB=cir_2)  # -> Points, ParamsA, ParamsB
end_4 = EndPoints(Curve=crv_3)  # -> Start, End
multiplication_10 = Multiplication(A=multiplication_5, B=inner_curve_blend_radius)
multiplication_11 = Multiplication(A=multiplication_6, B=inner_curve_blend_radius)
multiplication_12 = Multiplication(A=multiplication_4, B=inner_curve_blend_radius)
crv_4 = Curve(mid_profile)
rev = ReverseList(List=flatten(sec.Curves))
shatter = Shatter(Curve=crv_2, Parameters=ccx_2.ParamsA)
eval = EvaluateCurve(Curve=ln, Parameter=ccx.ParamsA)  # -> Point, Tangent, Length
shatter_2 = Shatter(Curve=ln, Parameters=ccx.ParamsA)
crv_cp_3 = CurveCP(Point=end_4.End, Curve=crv_3)  # -> Point, Parameter, Distance
xy_7 = XYPlane(Origin=Point(0, 0, 0))
eval_2 = EvaluateCurve(Curve=crv_2, Parameter=ccx_2.ParamsA)  # -> Point, Tangent, Length
item = ListItem(List=shatter_2, Index=1, Wrap=False)
item_2 = ListItem(List=shatter, Index=1, Wrap=False)
item_3 = ListItem(List=rev, Index=2, Wrap=False)
crv_5 = Curve(item_3)
end_5 = EndPoints(Curve=crv_5)  # -> Start, End
cp_2 = PlaneCP(Point=end_5.Start, Plane=xy_3)  # -> Point, UVPoint, Distance
yz_4 = YZPlane(Origin=cp_2.Point)
crv_6 = Curve(crv_5)
yz_5 = YZPlane(Origin=end_5.Start)
ln_2 = Line(PointA=end_5.Start, PointB=cp_2.Point)
rotate_2 = Rotate(Geometry=ln_2, Angle=neg_3, Plane=yz_4)  # -> Geometry, Transform
move_4 = Move(Geometry=rotate_2.Geometry, Translation=Y_3)  # -> Geometry, Transform
cir_3 = Circle(Plane=yz_5, Radius=multiplication_9)
cir_4 = Circle(Plane=yz_5, Radius=multiplication_4)
ccx_3 = CurveCurve(CurveA=ln_2, CurveB=cir_3)  # -> Points, ParamsA, ParamsB
ccx_4 = CurveCurve(CurveA=crv_5, CurveB=cir_4)  # -> Points, ParamsA, ParamsB
end_6 = EndPoints(Curve=crv_6)  # -> Start, End
shatter_3 = Shatter(Curve=crv_5, Parameters=ccx_4.ParamsA)
eval_3 = EvaluateCurve(Curve=ln_2, Parameter=ccx_3.ParamsA)  # -> Point, Tangent, Length
shatter_4 = Shatter(Curve=ln_2, Parameters=ccx_3.ParamsA)
crv_cp_4 = CurveCP(Point=end_6.End, Curve=crv_6)  # -> Point, Parameter, Distance
eval_4 = EvaluateCurve(Curve=crv_5, Parameter=ccx_4.ParamsA)  # -> Point, Tangent, Length
item_4 = ListItem(List=rev, Index=1, Wrap=False)
crv_7 = Curve(item_4)
end_7 = EndPoints(Curve=crv_7)  # -> Start, End
cp_3 = PlaneCP(Point=end_7.Start, Plane=xy_2)  # -> Point, UVPoint, Distance
yz_6 = YZPlane(Origin=cp_3.Point)
crv_8 = Curve(crv_7)
yz_7 = YZPlane(Origin=end_7.Start)
ln_3 = Line(PointA=end_7.Start, PointB=cp_3.Point)
rotate_3 = Rotate(Geometry=ln_3, Angle=neg_2, Plane=yz_6)  # -> Geometry, Transform
move_5 = Move(Geometry=rotate_3.Geometry, Translation=Y_2)  # -> Geometry, Transform
cir_5 = Circle(Plane=yz_7, Radius=multiplication_8)
cir_6 = Circle(Plane=yz_7, Radius=multiplication_6)
ccx_5 = CurveCurve(CurveA=ln_3, CurveB=cir_5)  # -> Points, ParamsA, ParamsB
ccx_6 = CurveCurve(CurveA=crv_7, CurveB=cir_6)  # -> Points, ParamsA, ParamsB
end_8 = EndPoints(Curve=crv_8)  # -> Start, End
shatter_5 = Shatter(Curve=crv_7, Parameters=ccx_6.ParamsA)
eval_5 = EvaluateCurve(Curve=ln_3, Parameter=ccx_5.ParamsA)  # -> Point, Tangent, Length
shatter_6 = Shatter(Curve=ln_3, Parameters=ccx_5.ParamsA)
crv_cp_5 = CurveCP(Point=end_8.End, Curve=crv_8)  # -> Point, Parameter, Distance
eval_6 = EvaluateCurve(Curve=crv_7, Parameter=ccx_6.ParamsA)  # -> Point, Tangent, Length
item_5 = ListItem(List=shatter_6, Index=1, Wrap=False)
item_6 = ListItem(List=shatter_5, Index=1, Wrap=False)
item_7 = ListItem(List=shatter_4, Index=1, Wrap=False)
multiplication_13 = Multiplication(A=multiplication_5, B=curve_blend_vector_ratio)
item_8 = ListItem(List=shatter_3, Index=1, Wrap=False)
multiplication_14 = Multiplication(A=multiplication_7, B=curve_blend_vector_ratio)
end_9 = EndPoints(Curve=crv_4)  # -> Start, End
cp_4 = PlaneCP(Point=end_9.Start, Plane=xy_7)  # -> Point, UVPoint, Distance
multiplication_15 = Multiplication(A=multiplication_6, B=curve_blend_vector_ratio)
multiplication_16 = Multiplication(A=seat_thickness, B=outer_curve_blend_radius)
multiplication_17 = Multiplication(A=multiplication_8, B=curve_blend_vector_ratio)
multiplication_18 = Multiplication(A=multiplication_4, B=curve_blend_vector_ratio)
multiplication_19 = Multiplication(A=multiplication_9, B=curve_blend_vector_ratio)
yz_8 = YZPlane(Origin=Point(0, 0, 0))
yz_9 = YZPlane(Origin=end_9.Start)
yz_10 = YZPlane(Origin=Point(0, 0, 0))
yz_11 = YZPlane(Origin=Point(0, 0, 0))
multiplication_20 = Multiplication(A=multiplication_16, B=asym_ratio)
ln_4 = Line(PointA=end_9.Start, PointB=cp_4.Point)
multiplication_21 = Multiplication(A=multiplication_13, B=inner_curve_blend_radius)
multiplication_22 = Multiplication(A=multiplication_15, B=inner_curve_blend_radius)
cir_7 = Circle(Plane=yz_9, Radius=multiplication_20)
cir_8 = Circle(Plane=yz_9, Radius=multiplication_16)
multiplication_23 = Multiplication(A=multiplication_18, B=inner_curve_blend_radius)
amp = Amplitude(Vector=eval_2.Tangent, Amplitude=multiplication_13)
amp_2 = Amplitude(Vector=eval.Tangent, Amplitude=multiplication_14)
amp_3 = Amplitude(Vector=eval_6.Tangent, Amplitude=multiplication_15)
multiplication_24 = Multiplication(A=multiplication_21, B=inner_curve_blend_vector_variation)
amp_4 = Amplitude(Vector=eval_5.Tangent, Amplitude=multiplication_17)
multiplication_25 = Multiplication(A=multiplication_22, B=inner_curve_blend_vector_variation)
ccx_7 = CurveCurve(CurveA=ln_4, CurveB=cir_7)  # -> Points, ParamsA, ParamsB
ccx_8 = CurveCurve(CurveA=crv_4, CurveB=cir_8)  # -> Points, ParamsA, ParamsB
multiplication_26 = Multiplication(A=multiplication_23, B=inner_curve_blend_vector_variation)
rev_2 = Reverse(Vector=amp)
rev_3 = Reverse(Vector=amp_2)
rev_4 = Reverse(Vector=amp_3)
rev_5 = Reverse(Vector=amp_4)
shatter_7 = Shatter(Curve=crv_4, Parameters=ccx_8.ParamsA)
eval_7 = EvaluateCurve(Curve=ln_4, Parameter=ccx_7.ParamsA)  # -> Point, Tangent, Length
eval_8 = EvaluateCurve(Curve=crv_4, Parameter=ccx_8.ParamsA)  # -> Point, Tangent, Length
bzspan = BezierSpan(StartPoint=eval_2.Point, StartTangent=rev_2, EndPoint=eval.Point, EndTangent=rev_3)  # -> Curve, Length, Domain
bzspan_2 = BezierSpan(StartPoint=eval_6.Point, StartTangent=rev_4, EndPoint=eval_5.Point, EndTangent=rev_5)  # -> Curve, Length, Domain
multiplication_27 = Multiplication(A=multiplication_16, B=curve_blend_vector_ratio)
multiplication_28 = Multiplication(A=multiplication_20, B=curve_blend_vector_ratio)
amp_5 = Amplitude(Vector=eval_4.Tangent, Amplitude=multiplication_18)
amp_6 = Amplitude(Vector=eval_3.Tangent, Amplitude=multiplication_19)
item_9 = ListItem(List=shatter_7, Index=1, Wrap=False)
rev_6 = Reverse(Vector=amp_5)
rev_7 = Reverse(Vector=amp_6)
bzspan_3 = BezierSpan(StartPoint=eval_4.Point, StartTangent=rev_6, EndPoint=eval_3.Point, EndTangent=rev_7)  # -> Curve, Length, Domain
amp_7 = Amplitude(Vector=eval_8.Tangent, Amplitude=multiplication_27)
amp_8 = Amplitude(Vector=eval_7.Tangent, Amplitude=multiplication_28)
rev_8 = Reverse(Vector=amp_7)
rev_9 = Reverse(Vector=amp_8)
num = Number(multiplication_9)
addition = Addition(A=num, B=seat_thickness)
divlength = DivideLength(Curve=item_7, Length=addition)  # -> Points, Tangents, Parameters
item_10 = ListItem(List=divlength.Points, Index=0, Wrap=False)
item_11 = ListItem(List=divlength.Points, Index=1, Wrap=False)
ln_5 = Line(PointA=item_10, PointB=item_11)
bzspan_4 = BezierSpan(StartPoint=eval_8.Point, StartTangent=rev_8, EndPoint=eval_7.Point, EndTangent=rev_9)  # -> Curve, Length, Domain
join = JoinCurves(Curves=flatten([item_9, bzspan_4.Curve]), Preserve=False)
yz_12 = YZPlane(Origin=Point(0, 0, 0))
neg_4 = Negative(Input=seat_thickness)
join_2 = JoinCurves(Curves=flatten([bzspan.Curve, item_2]), Preserve=False)
yz_13 = YZPlane(Origin=Point(0, 0, 0))
neg_5 = Negative(Input=seat_thickness)
offset = Offset(Curve=join, Distance=neg_4, Plane=yz_12, Corners=1)
offset_2 = Offset(Curve=join_2, Distance=neg_5, Plane=yz_13, Corners=1)
crv_9 = Curve(join_2)
crv_10 = Curve(offset_2)
crv_11 = Curve(offset)
crv_12 = Curve(join)
end_10 = EndPoints(Curve=crv_12)  # -> Start, End
crv_13 = Curve(ln_5)
end_11 = EndPoints(Curve=crv_10)  # -> Start, End
end_12 = EndPoints(Curve=crv_10)  # -> Start, End
end_13 = EndPoints(Curve=crv_9)  # -> Start, End
end_14 = EndPoints(Curve=crv_9)  # -> Start, End
end_15 = EndPoints(Curve=crv_11)  # -> Start, End
crv_14 = Curve(item)
crv_15 = Curve(item_5)
end_16 = EndPoints(Curve=crv_11)  # -> Start, End
end_17 = EndPoints(Curve=crv_12)  # -> Start, End
crv_cp_6 = CurveCP(Point=end_13.End, Curve=crv_9)  # -> Point, Parameter, Distance
crv_cp_7 = CurveCP(Point=end_11.End, Curve=crv_10)  # -> Point, Parameter, Distance
end_18 = EndPoints(Curve=crv_14)  # -> Start, End
crv_cp_8 = CurveCP(Point=end_14.Start, Curve=crv_9)  # -> Point, Parameter, Distance
end_19 = EndPoints(Curve=crv_13)  # -> Start, End
end_20 = EndPoints(Curve=crv_15)  # -> Start, End
crv_cp_9 = CurveCP(Point=end_12.Start, Curve=crv_10)  # -> Point, Parameter, Distance
crv_cp_10 = CurveCP(Point=end_10.End, Curve=crv_12)  # -> Point, Parameter, Distance
crv_cp_11 = CurveCP(Point=end_15.End, Curve=crv_11)  # -> Point, Parameter, Distance
crv_cp_12 = CurveCP(Point=end_17.Start, Curve=crv_12)  # -> Point, Parameter, Distance
crv_cp_13 = CurveCP(Point=end_16.Start, Curve=crv_11)  # -> Point, Parameter, Distance
eval_9 = EvaluateCurve(Curve=crv_9, Parameter=crv_cp_6.Parameter)  # -> Point, Tangent, Length
crv_cp_14 = CurveCP(Point=end_19.End, Curve=crv_13)  # -> Point, Parameter, Distance
eval_10 = EvaluateCurve(Curve=crv_10, Parameter=crv_cp_8.Parameter)  # -> Point, Tangent, Length
eval_11 = EvaluateCurve(Curve=crv_10, Parameter=crv_cp_7.Parameter)  # -> Point, Tangent, Length
eval_12 = EvaluateCurve(Curve=crv_10, Parameter=crv_cp_9.Parameter)  # -> Point, Tangent, Length
eval_13 = EvaluateCurve(Curve=crv_11, Parameter=crv_cp_12.Parameter)  # -> Point, Tangent, Length
eval_14 = EvaluateCurve(Curve=crv_12, Parameter=crv_cp_10.Parameter)  # -> Point, Tangent, Length
eval_15 = EvaluateCurve(Curve=crv_11, Parameter=crv_cp_11.Parameter)  # -> Point, Tangent, Length
eval_16 = EvaluateCurve(Curve=crv_11, Parameter=crv_cp_13.Parameter)  # -> Point, Tangent, Length
eval_17 = EvaluateCurve(Curve=crv_13, Parameter=crv_cp_14.Parameter)  # -> Point, Tangent, Length
amp_9 = Amplitude(Vector=eval_9.Tangent, Amplitude=multiplication)
amp_10 = Amplitude(Vector=eval_10.Tangent, Amplitude=multiplication)
amp_11 = Amplitude(Vector=eval_11.Tangent, Amplitude=multiplication)
amp_12 = Amplitude(Vector=eval_12.Tangent, Amplitude=multiplication)
amp_13 = Amplitude(Vector=eval_14.Tangent, Amplitude=multiplication)
amp_14 = Amplitude(Vector=eval_13.Tangent, Amplitude=multiplication)
amp_15 = Amplitude(Vector=eval_15.Tangent, Amplitude=multiplication)
amp_16 = Amplitude(Vector=eval_16.Tangent, Amplitude=multiplication)
rev_10 = Reverse(Vector=amp_9)
rev_11 = Reverse(Vector=amp_10)
amp_17 = Amplitude(Vector=eval_17.Tangent, Amplitude=multiplication)
rev_12 = Reverse(Vector=amp_11)
rev_13 = Reverse(Vector=amp_12)
rev_14 = Reverse(Vector=amp_13)
rev_15 = Reverse(Vector=amp_14)
rev_16 = Reverse(Vector=amp_15)
rev_17 = Reverse(Vector=amp_16)
bzspan_5 = BezierSpan(StartPoint=end_13.End, StartTangent=amp_11, EndPoint=end_11.End, EndTangent=amp_11)  # -> Curve, Length, Domain
bzspan_6 = BezierSpan(StartPoint=end_14.Start, StartTangent=rev_11, EndPoint=end_12.Start, EndTangent=rev_13)  # -> Curve, Length, Domain
bzspan_7 = BezierSpan(StartPoint=end_10.End, StartTangent=amp_15, EndPoint=end_15.End, EndTangent=amp_15)  # -> Curve, Length, Domain
bzspan_8 = BezierSpan(StartPoint=end_17.Start, StartTangent=rev_15, EndPoint=end_16.Start, EndTangent=rev_17)  # -> Curve, Length, Domain
join_3 = JoinCurves(Curves=flatten([bzspan_6.Curve, bzspan_5.Curve, crv_9, crv_10]), Preserve=False)
join_4 = JoinCurves(Curves=flatten([bzspan_6.Curve, crv_9]), Preserve=False)
join_5 = JoinCurves(Curves=flatten([bzspan_8.Curve, bzspan_7.Curve, crv_12, crv_11]), Preserve=False)
join_6 = JoinCurves(Curves=flatten([bzspan_8.Curve, crv_12]), Preserve=False)
num_2 = Number(division_2)
yz_14 = YZPlane(Origin=Point(0, 0, 0))
offset_3 = Offset(Curve=crv, Distance=seat_thickness, Plane=yz_14, Corners=1)
end_21 = EndPoints(Curve=offset_3)  # -> Start, End
end_22 = EndPoints(Curve=offset_3)  # -> Start, End
crv_cp_15 = CurveCP(Point=end_22.Start, Curve=offset_3)  # -> Point, Parameter, Distance
crv_cp_16 = CurveCP(Point=end_21.End, Curve=offset_3)  # -> Point, Parameter, Distance
eval_18 = EvaluateCurve(Curve=offset_3, Parameter=crv_cp.Parameter)  # -> Point, Tangent, Length
eval_19 = EvaluateCurve(Curve=offset_3, Parameter=crv_cp_2.Parameter)  # -> Point, Tangent, Length
eval_20 = EvaluateCurve(Curve=offset_3, Parameter=crv_cp_15.Parameter)  # -> Point, Tangent, Length
eval_21 = EvaluateCurve(Curve=offset_3, Parameter=crv_cp_16.Parameter)  # -> Point, Tangent, Length
rev_18 = Reverse(Vector=eval_19.Tangent)
rev_19 = Reverse(Vector=eval_20.Tangent)
rev_20 = Reverse(Vector=eval_21.Tangent)
amp_18 = Amplitude(Vector=rev_19, Amplitude=multiplication)
amp_19 = Amplitude(Vector=rev_18, Amplitude=multiplication)
bzspan_9 = BezierSpan(StartPoint=end_2.Start, StartTangent=amp_19, EndPoint=end_22.Start, EndTangent=amp_18)  # -> Curve, Length, Domain
offset_4 = Offset(Curve=crv_3, Distance=seat_thickness, Plane=yz_14, Corners=1)
ccx_9 = CurveCurve(CurveA=offset_4, CurveB=move_2.Geometry)  # -> Points, ParamsA, ParamsB
offset_5 = Offset(Curve=crv_8, Distance=seat_thickness, Plane=yz_14, Corners=1)
ccx_10 = CurveCurve(CurveA=offset_5, CurveB=move_5.Geometry)  # -> Points, ParamsA, ParamsB
offset_6 = Offset(Curve=crv_6, Distance=seat_thickness, Plane=yz_14, Corners=1)
ccx_11 = CurveCurve(CurveA=offset_6, CurveB=move_4.Geometry)  # -> Points, ParamsA, ParamsB
end_23 = EndPoints(Curve=offset_4)  # -> Start, End
cp_5 = PlaneCP(Point=end_23.End, Plane=xy_4)  # -> Point, UVPoint, Distance
shatter_8 = Shatter(Curve=move_2.Geometry, Parameters=ccx_9.ParamsB)
shatter_9 = Shatter(Curve=offset_4, Parameters=ccx_9.ParamsA)
end_24 = EndPoints(Curve=offset_5)  # -> Start, End
pt = Point(end_24.End)
cp_6 = PlaneCP(Point=pt, Plane=xy_5)  # -> Point, UVPoint, Distance
shatter_10 = Shatter(Curve=move_5.Geometry, Parameters=ccx_10.ParamsB)
shatter_11 = Shatter(Curve=offset_5, Parameters=ccx_10.ParamsA)
shatter_12 = Shatter(Curve=move_4.Geometry, Parameters=ccx_11.ParamsB)
end_25 = EndPoints(Curve=offset_6)  # -> Start, End
pt_2 = Point(end_25.End)
cp_7 = PlaneCP(Point=pt_2, Plane=xy_6)  # -> Point, UVPoint, Distance
shatter_13 = Shatter(Curve=offset_6, Parameters=ccx_11.ParamsA)
crv_cp_17 = CurveCP(Point=cp_5.Point, Curve=crv_3)  # -> Point, Parameter, Distance
crv_cp_18 = CurveCP(Point=cp_6.Point, Curve=crv_8)  # -> Point, Parameter, Distance
crv_cp_19 = CurveCP(Point=cp_7.Point, Curve=crv_6)  # -> Point, Parameter, Distance
item_12 = ListItem(List=shatter_9, Index=1, Wrap=False)
item_13 = ListItem(List=shatter_8, Index=1, Wrap=False)
crv_cp_20 = CurveCP(Point=end_23.End, Curve=offset_4)  # -> Point, Parameter, Distance
item_14 = ListItem(List=shatter_11, Index=1, Wrap=False)
item_15 = ListItem(List=shatter_10, Index=1, Wrap=False)
crv_cp_21 = CurveCP(Point=end_24.End, Curve=offset_5)  # -> Point, Parameter, Distance
item_16 = ListItem(List=shatter_13, Index=1, Wrap=False)
item_17 = ListItem(List=shatter_12, Index=1, Wrap=False)
crv_cp_22 = CurveCP(Point=end_25.End, Curve=offset_6)  # -> Point, Parameter, Distance
vec2pt = Vector2Pt(PointA=crv_cp_17.Point, PointB=cp_5.Point, Unitize=False)  # -> Vector, Length
vec2pt_2 = Vector2Pt(PointA=crv_cp_18.Point, PointB=cp_6.Point, Unitize=False)  # -> Vector, Length
vec2pt_3 = Vector2Pt(PointA=crv_cp_19.Point, PointB=cp_7.Point, Unitize=False)  # -> Vector, Length
eval_22 = EvaluateCurve(Curve=offset_4, Parameter=crv_cp_20.Parameter)  # -> Point, Tangent, Length
eval_23 = EvaluateCurve(Curve=offset_5, Parameter=crv_cp_21.Parameter)  # -> Point, Tangent, Length
eval_24 = EvaluateCurve(Curve=offset_6, Parameter=crv_cp_22.Parameter)  # -> Point, Tangent, Length
yz_15 = YZPlane(Origin=ccx_9.Points)
move_6 = Move(Geometry=cp_5.Point, Translation=vec2pt.Vector)  # -> Geometry, Transform
yz_16 = YZPlane(Origin=ccx_10.Points)
yz_17 = YZPlane(Origin=ccx_11.Points)
move_7 = Move(Geometry=cp_6.Point, Translation=vec2pt_2.Vector)  # -> Geometry, Transform
move_8 = Move(Geometry=cp_7.Point, Translation=vec2pt_3.Vector)  # -> Geometry, Transform
eval_25 = EvaluateCurve(Curve=offset_4, Parameter=crv_cp_3.Parameter)  # -> Point, Tangent, Length
eval_26 = EvaluateCurve(Curve=offset_5, Parameter=crv_cp_5.Parameter)  # -> Point, Tangent, Length
eval_27 = EvaluateCurve(Curve=offset_6, Parameter=crv_cp_4.Parameter)  # -> Point, Tangent, Length
cir_9 = Circle(Plane=yz_15, Radius=multiplication_10)
ln_6 = Line(PointA=move_6.Geometry, PointB=crv_cp_17.Point)
cir_10 = Circle(Plane=yz_16, Radius=multiplication_11)
cir_11 = Circle(Plane=yz_17, Radius=multiplication_12)
ln_7 = Line(PointA=move_7.Geometry, PointB=crv_cp_18.Point)
ln_8 = Line(PointA=move_8.Geometry, PointB=crv_cp_19.Point)
amp_20 = Amplitude(Vector=eval_22.Tangent, Amplitude=multiplication)
amp_21 = Amplitude(Vector=eval_23.Tangent, Amplitude=multiplication)
amp_22 = Amplitude(Vector=eval_24.Tangent, Amplitude=multiplication)
offset_7 = Offset(Curve=ln_6, Distance=seat_thickness, Plane=yz_8, Corners=1)
offset_8 = Offset(Curve=ln_7, Distance=seat_thickness, Plane=yz_10, Corners=1)
offset_9 = Offset(Curve=ln_8, Distance=seat_thickness, Plane=yz_11, Corners=1)
ccx_12 = CurveCurve(CurveA=item_13, CurveB=cir_9)  # -> Points, ParamsA, ParamsB
ccx_13 = CurveCurve(CurveA=item_12, CurveB=cir_9)  # -> Points, ParamsA, ParamsB
ccx_14 = CurveCurve(CurveA=item_15, CurveB=cir_10)  # -> Points, ParamsA, ParamsB
ccx_15 = CurveCurve(CurveA=item_17, CurveB=cir_11)  # -> Points, ParamsA, ParamsB
ccx_16 = CurveCurve(CurveA=item_14, CurveB=cir_10)  # -> Points, ParamsA, ParamsB
amp_23 = Amplitude(Vector=eval_25.Tangent, Amplitude=multiplication)
ccx_17 = CurveCurve(CurveA=item_16, CurveB=cir_11)  # -> Points, ParamsA, ParamsB
amp_24 = Amplitude(Vector=eval_26.Tangent, Amplitude=multiplication)
amp_25 = Amplitude(Vector=eval_27.Tangent, Amplitude=multiplication)
plx = LinePlane(Line=offset_7, Plane=xy_4)  # -> Point, ParamL, ParamP
plx_2 = LinePlane(Line=offset_8, Plane=xy_5)  # -> Point, ParamL, ParamP
shatter_14 = Shatter(Curve=item_13, Parameters=ccx_12.ParamsA)
plx_3 = LinePlane(Line=offset_9, Plane=xy_6)  # -> Point, ParamL, ParamP
eval_28 = EvaluateCurve(Curve=item_12, Parameter=ccx_13.ParamsA)  # -> Point, Tangent, Length
shatter_15 = Shatter(Curve=item_12, Parameters=ccx_13.ParamsA)
shatter_16 = Shatter(Curve=item_15, Parameters=ccx_14.ParamsA)
eval_29 = EvaluateCurve(Curve=item_14, Parameter=ccx_16.ParamsA)  # -> Point, Tangent, Length
shatter_17 = Shatter(Curve=item_14, Parameters=ccx_16.ParamsA)
shatter_18 = Shatter(Curve=item_17, Parameters=ccx_15.ParamsA)
eval_30 = EvaluateCurve(Curve=item_16, Parameter=ccx_17.ParamsA)  # -> Point, Tangent, Length
shatter_19 = Shatter(Curve=item_16, Parameters=ccx_17.ParamsA)
eval_31 = EvaluateCurve(Curve=item_13, Parameter=ccx_12.ParamsA)  # -> Point, Tangent, Length
yz_18 = YZPlane(Origin=plx.Point)
eval_32 = EvaluateCurve(Curve=item_15, Parameter=ccx_14.ParamsA)  # -> Point, Tangent, Length
eval_33 = EvaluateCurve(Curve=item_17, Parameter=ccx_15.ParamsA)  # -> Point, Tangent, Length
yz_19 = YZPlane(Origin=plx_2.Point)
yz_20 = YZPlane(Origin=plx_3.Point)
bzspan_10 = BezierSpan(StartPoint=end_4.End, StartTangent=amp_23, EndPoint=end_23.End, EndTangent=amp_20)  # -> Curve, Length, Domain
bzspan_11 = BezierSpan(StartPoint=end_8.End, StartTangent=amp_24, EndPoint=end_24.End, EndTangent=amp_21)  # -> Curve, Length, Domain
bzspan_12 = BezierSpan(StartPoint=end_6.End, StartTangent=amp_25, EndPoint=end_25.End, EndTangent=amp_22)  # -> Curve, Length, Domain
item_18 = ListItem(List=shatter_15, Index=1, Wrap=False)
item_19 = ListItem(List=shatter_14, Index=1, Wrap=False)
item_20 = ListItem(List=shatter_17, Index=1, Wrap=False)
item_21 = ListItem(List=shatter_16, Index=1, Wrap=False)
item_22 = ListItem(List=shatter_19, Index=1, Wrap=False)
item_23 = ListItem(List=shatter_18, Index=1, Wrap=False)
rotate_4 = Rotate(Geometry=offset_7, Angle=neg, Plane=yz_18)  # -> Geometry, Transform
rotate_5 = Rotate(Geometry=offset_8, Angle=neg_2, Plane=yz_19)  # -> Geometry, Transform
rotate_6 = Rotate(Geometry=offset_9, Angle=neg_3, Plane=yz_20)  # -> Geometry, Transform
ccx_18 = CurveCurve(CurveA=ln_6, CurveB=item_18)  # -> Points, ParamsA, ParamsB
plx_4 = LinePlane(Line=ln_6, Plane=xy_4)  # -> Point, ParamL, ParamP
ccx_19 = CurveCurve(CurveA=ln_7, CurveB=item_20)  # -> Points, ParamsA, ParamsB
ccx_20 = CurveCurve(CurveA=ln_8, CurveB=item_22)  # -> Points, ParamsA, ParamsB
plx_5 = LinePlane(Line=ln_7, Plane=xy_5)  # -> Point, ParamL, ParamP
plx_6 = LinePlane(Line=ln_8, Plane=xy_6)  # -> Point, ParamL, ParamP
ccx_21 = CurveCurve(CurveA=rotate_4.Geometry, CurveB=item_18)  # -> Points, ParamsA, ParamsB
plx_7 = LinePlane(Line=rotate_4.Geometry, Plane=xy_4)  # -> Point, ParamL, ParamP
ccx_22 = CurveCurve(CurveA=rotate_5.Geometry, CurveB=item_20)  # -> Points, ParamsA, ParamsB
plx_8 = LinePlane(Line=rotate_5.Geometry, Plane=xy_5)  # -> Point, ParamL, ParamP
ccx_23 = CurveCurve(CurveA=rotate_6.Geometry, CurveB=item_22)  # -> Points, ParamsA, ParamsB
plx_9 = LinePlane(Line=rotate_6.Geometry, Plane=xy_6)  # -> Point, ParamL, ParamP
ln_9 = Line(PointA=ccx_23.Points, PointB=plx_9.Point)
crv_cp_23 = CurveCP(Point=item_11, Curve=ln_9)  # -> Point, Parameter, Distance
amp_26 = Amplitude(Vector=eval_31.Tangent, Amplitude=multiplication_24)
amp_27 = Amplitude(Vector=eval_28.Tangent, Amplitude=multiplication_24)
amp_28 = Amplitude(Vector=eval_32.Tangent, Amplitude=multiplication_25)
amp_29 = Amplitude(Vector=eval_29.Tangent, Amplitude=multiplication_25)
amp_30 = Amplitude(Vector=eval_33.Tangent, Amplitude=multiplication_26)
amp_31 = Amplitude(Vector=eval_30.Tangent, Amplitude=multiplication_26)
ln_10 = Line(PointA=ccx_20.Points, PointB=plx_6.Point)
rev_21 = Reverse(Vector=amp_26)
rev_22 = Reverse(Vector=amp_27)
rev_23 = Reverse(Vector=amp_28)
rev_24 = Reverse(Vector=amp_30)
rev_25 = Reverse(Vector=amp_29)
rev_26 = Reverse(Vector=amp_31)
bzspan_13 = BezierSpan(StartPoint=eval_31.Point, StartTangent=rev_21, EndPoint=eval_28.Point, EndTangent=rev_22)  # -> Curve, Length, Domain
bzspan_14 = BezierSpan(StartPoint=eval_32.Point, StartTangent=rev_23, EndPoint=eval_29.Point, EndTangent=rev_25)  # -> Curve, Length, Domain
bzspan_15 = BezierSpan(StartPoint=eval_33.Point, StartTangent=rev_24, EndPoint=eval_30.Point, EndTangent=rev_26)  # -> Curve, Length, Domain
divlength_2 = DivideLength(Curve=ln_10, Length=addition)  # -> Points, Tangents, Parameters
ln_11 = Line(PointA=ccx_23.Points, PointB=plx_9.Point)
item_24 = ListItem(List=divlength_2.Points, Index=1, Wrap=False)
crv_cp_24 = CurveCP(Point=item_24, Curve=ln_11)  # -> Point, Parameter, Distance
crv_16 = Curve(item_18)
crv_17 = Curve(item_20)
ln_12 = Line(PointA=ccx_23.Points, PointB=crv_cp_24.Point)
crv_18 = Curve(item_22)
yz_21 = YZPlane(Origin=ccx_21.Points)
ln_13 = Line(PointA=ccx_20.Points, PointB=item_24)
yz_22 = YZPlane(Origin=ccx_18.Points)
yz_23 = YZPlane(Origin=ccx_22.Points)
yz_24 = YZPlane(Origin=ccx_23.Points)
yz_25 = YZPlane(Origin=ccx_19.Points)
yz_26 = YZPlane(Origin=ccx_20.Points)
ln_14 = Line(PointA=ccx_21.Points, PointB=plx_7.Point)
ln_15 = Line(PointA=ccx_22.Points, PointB=plx_8.Point)
crv_19 = Curve(item_23)
cir_12 = Circle(Plane=yz_21, Radius=multiplication_7)
cir_13 = Circle(Plane=yz_23, Radius=multiplication_8)
ln_16 = Line(PointA=ccx_18.Points, PointB=plx_4.Point)
cir_14 = Circle(Plane=yz_24, Radius=num)
cir_15 = Circle(Plane=yz_22, Radius=multiplication_10)
ln_17 = Line(PointA=ccx_19.Points, PointB=plx_5.Point)
cir_16 = Circle(Plane=yz_25, Radius=multiplication_11)
cir_17 = Circle(Plane=yz_26, Radius=multiplication_12)
crv_cp_25 = CurveCP(Point=item_11, Curve=crv_19)  # -> Point, Parameter, Distance
end_26 = EndPoints(Curve=crv_19)  # -> Start, End
ccx_24 = CurveCurve(CurveA=crv_16, CurveB=cir_12)  # -> Points, ParamsA, ParamsB
ccx_25 = CurveCurve(CurveA=ln_14, CurveB=cir_12)  # -> Points, ParamsA, ParamsB
ccx_26 = CurveCurve(CurveA=crv_16, CurveB=cir_15)  # -> Points, ParamsA, ParamsB
ccx_27 = CurveCurve(CurveA=crv_17, CurveB=cir_13)  # -> Points, ParamsA, ParamsB
ccx_28 = CurveCurve(CurveA=ln_16, CurveB=cir_15)  # -> Points, ParamsA, ParamsB
ccx_29 = CurveCurve(CurveA=ln_15, CurveB=cir_13)  # -> Points, ParamsA, ParamsB
ccx_30 = CurveCurve(CurveA=crv_18, CurveB=cir_14)  # -> Points, ParamsA, ParamsB
ccx_31 = CurveCurve(CurveA=crv_17, CurveB=cir_16)  # -> Points, ParamsA, ParamsB
ccx_32 = CurveCurve(CurveA=ln_12, CurveB=cir_14)  # -> Points, ParamsA, ParamsB
ccx_33 = CurveCurve(CurveA=ln_17, CurveB=cir_16)  # -> Points, ParamsA, ParamsB
ccx_34 = CurveCurve(CurveA=crv_18, CurveB=cir_17)  # -> Points, ParamsA, ParamsB
ccx_35 = CurveCurve(CurveA=ln_13, CurveB=cir_17)  # -> Points, ParamsA, ParamsB
item_25 = ListItem(List=ccx_24.ParamsA, Index=1, Wrap=False)
item_26 = ListItem(List=ccx_26.ParamsA, Index=0, Wrap=False)
item_27 = ListItem(List=ccx_27.ParamsA, Index=1, Wrap=False)
item_28 = ListItem(List=ccx_30.ParamsA, Index=1, Wrap=False)
item_29 = ListItem(List=ccx_31.ParamsA, Index=0, Wrap=False)
item_30 = ListItem(List=ccx_34.ParamsA, Index=0, Wrap=False)
shatter_20 = Shatter(Curve=ln_14, Parameters=ccx_25.ParamsA)
eval_34 = EvaluateCurve(Curve=ln_14, Parameter=ccx_25.ParamsA)  # -> Point, Tangent, Length
shatter_21 = Shatter(Curve=ln_16, Parameters=ccx_28.ParamsA)
eval_35 = EvaluateCurve(Curve=ln_16, Parameter=ccx_28.ParamsA)  # -> Point, Tangent, Length
shatter_22 = Shatter(Curve=ln_15, Parameters=ccx_29.ParamsA)
eval_36 = EvaluateCurve(Curve=ln_15, Parameter=ccx_29.ParamsA)  # -> Point, Tangent, Length
shatter_23 = Shatter(Curve=ln_12, Parameters=ccx_32.ParamsA)
eval_37 = EvaluateCurve(Curve=ln_12, Parameter=ccx_32.ParamsA)  # -> Point, Tangent, Length
shatter_24 = Shatter(Curve=ln_17, Parameters=ccx_33.ParamsA)
eval_38 = EvaluateCurve(Curve=ln_17, Parameter=ccx_33.ParamsA)  # -> Point, Tangent, Length
ln_18 = Line(PointA=end_26.Start, PointB=crv_cp_25.Point)
shatter_25 = Shatter(Curve=ln_13, Parameters=ccx_35.ParamsA)
eval_39 = EvaluateCurve(Curve=ln_13, Parameter=ccx_35.ParamsA)  # -> Point, Tangent, Length
shatter_26 = Shatter(Curve=crv_16, Parameters=item_25)
shatter_27 = Shatter(Curve=crv_16, Parameters=item_26)
shatter_28 = Shatter(Curve=crv_17, Parameters=item_27)
eval_40 = EvaluateCurve(Curve=crv_16, Parameter=item_25)  # -> Point, Tangent, Length
shatter_29 = Shatter(Curve=crv_18, Parameters=item_28)
shatter_30 = Shatter(Curve=crv_17, Parameters=item_29)
eval_41 = EvaluateCurve(Curve=crv_16, Parameter=item_26)  # -> Point, Tangent, Length
shatter_31 = Shatter(Curve=crv_18, Parameters=item_30)
eval_42 = EvaluateCurve(Curve=crv_17, Parameter=item_27)  # -> Point, Tangent, Length
eval_43 = EvaluateCurve(Curve=crv_18, Parameter=item_28)  # -> Point, Tangent, Length
eval_44 = EvaluateCurve(Curve=crv_17, Parameter=item_29)  # -> Point, Tangent, Length
eval_45 = EvaluateCurve(Curve=crv_18, Parameter=item_30)  # -> Point, Tangent, Length
item_31 = ListItem(List=shatter_26, Index=1, Wrap=False)
item_32 = ListItem(List=shatter_20, Index=1, Wrap=False)
crv_20 = Curve(item_32)
item_33 = ListItem(List=shatter_21, Index=1, Wrap=False)
crv_21 = Curve(item_33)
item_34 = ListItem(List=shatter_27, Index=0, Wrap=False)
crv_22 = Curve(item_19)
item_35 = ListItem(List=shatter_28, Index=1, Wrap=False)
item_36 = ListItem(List=shatter_22, Index=1, Wrap=False)
crv_23 = Curve(item_36)
item_37 = ListItem(List=shatter_29, Index=1, Wrap=False)
item_38 = ListItem(List=shatter_24, Index=1, Wrap=False)
crv_24 = Curve(item_38)
item_39 = ListItem(List=shatter_30, Index=0, Wrap=False)
crv_25 = Curve(item_21)
item_40 = ListItem(List=shatter_23, Index=1, Wrap=False)
crv_26 = Curve(item_40)
item_41 = ListItem(List=shatter_25, Index=1, Wrap=False)
crv_27 = Curve(item_41)
item_42 = ListItem(List=shatter_31, Index=0, Wrap=False)
end_27 = EndPoints(Curve=crv_20)  # -> Start, End
end_28 = EndPoints(Curve=crv_21)  # -> Start, End
end_29 = EndPoints(Curve=crv_22)  # -> Start, End
end_30 = EndPoints(Curve=crv_26)  # -> Start, End
end_31 = EndPoints(Curve=crv_27)  # -> Start, End
end_32 = EndPoints(Curve=ln_18)  # -> Start, End
end_33 = EndPoints(Curve=crv_23)  # -> Start, End
end_34 = EndPoints(Curve=crv_24)  # -> Start, End
end_35 = EndPoints(Curve=crv_25)  # -> Start, End
ln_19 = Line(PointA=end_27.End, PointB=end_28.End)
ln_20 = Line(PointA=end_18.End, PointB=end_29.End)
ln_21 = Line(PointA=end_33.End, PointB=end_34.End)
ln_22 = Line(PointA=end_20.End, PointB=end_35.End)
amp_32 = Amplitude(Vector=eval_40.Tangent, Amplitude=multiplication_14)
amp_33 = Amplitude(Vector=eval_34.Tangent, Amplitude=multiplication_14)
amp_34 = Amplitude(Vector=eval_41.Tangent, Amplitude=multiplication_24)
amp_35 = Amplitude(Vector=eval_35.Tangent, Amplitude=multiplication_24)
amp_36 = Amplitude(Vector=eval_42.Tangent, Amplitude=multiplication_17)
amp_37 = Amplitude(Vector=eval_36.Tangent, Amplitude=multiplication_17)
amp_38 = Amplitude(Vector=eval_43.Tangent, Amplitude=multiplication_19)
amp_39 = Amplitude(Vector=eval_37.Tangent, Amplitude=multiplication_19)
amp_40 = Amplitude(Vector=eval_44.Tangent, Amplitude=multiplication_25)
amp_41 = Amplitude(Vector=eval_38.Tangent, Amplitude=multiplication_25)
amp_42 = Amplitude(Vector=eval_45.Tangent, Amplitude=multiplication_26)
amp_43 = Amplitude(Vector=eval_39.Tangent, Amplitude=multiplication_26)
crv_cp_26 = CurveCP(Point=end_30.End, Curve=crv_26)  # -> Point, Parameter, Distance
crv_cp_27 = CurveCP(Point=end_31.End, Curve=crv_27)  # -> Point, Parameter, Distance
crv_cp_28 = CurveCP(Point=end_32.End, Curve=ln_18)  # -> Point, Parameter, Distance
join_7 = JoinCurves(Curves=flatten([crv_22, crv_14, ln_20, ln_19, crv_21, crv_20]), Preserve=False)
join_8 = JoinCurves(Curves=flatten([crv_25, crv_15, ln_22, ln_21, crv_24, crv_23]), Preserve=False)
rev_27 = Reverse(Vector=amp_32)
rev_28 = Reverse(Vector=amp_34)
rev_29 = Reverse(Vector=amp_33)
rev_30 = Reverse(Vector=amp_36)
rev_31 = Reverse(Vector=amp_35)
rev_32 = Reverse(Vector=amp_38)
rev_33 = Reverse(Vector=amp_40)
rev_34 = Reverse(Vector=amp_37)
rev_35 = Reverse(Vector=amp_42)
rev_36 = Reverse(Vector=amp_39)
rev_37 = Reverse(Vector=amp_41)
rev_38 = Reverse(Vector=amp_43)
eval_46 = EvaluateCurve(Curve=crv_26, Parameter=crv_cp_26.Parameter)  # -> Point, Tangent, Length
eval_47 = EvaluateCurve(Curve=crv_27, Parameter=crv_cp_27.Parameter)  # -> Point, Tangent, Length
eval_48 = EvaluateCurve(Curve=ln_18, Parameter=crv_cp_28.Parameter)  # -> Point, Tangent, Length
fillet = FilletDistance(Curve=join_7, Distance=feet_fillet)
fillet_2 = FilletDistance(Curve=join_8, Distance=feet_fillet)
bzspan_16 = BezierSpan(StartPoint=eval_40.Point, StartTangent=rev_27, EndPoint=eval_34.Point, EndTangent=rev_29)  # -> Curve, Length, Domain
bzspan_17 = BezierSpan(StartPoint=eval_41.Point, StartTangent=amp_34, EndPoint=eval_35.Point, EndTangent=rev_31)  # -> Curve, Length, Domain
bzspan_18 = BezierSpan(StartPoint=eval_42.Point, StartTangent=rev_30, EndPoint=eval_36.Point, EndTangent=rev_34)  # -> Curve, Length, Domain
bzspan_19 = BezierSpan(StartPoint=eval_43.Point, StartTangent=rev_32, EndPoint=eval_37.Point, EndTangent=rev_36)  # -> Curve, Length, Domain
bzspan_20 = BezierSpan(StartPoint=eval_44.Point, StartTangent=amp_40, EndPoint=eval_38.Point, EndTangent=rev_37)  # -> Curve, Length, Domain
bzspan_21 = BezierSpan(StartPoint=eval_45.Point, StartTangent=amp_42, EndPoint=eval_39.Point, EndTangent=rev_38)  # -> Curve, Length, Domain
amp_44 = Amplitude(Vector=eval_46.Tangent, Amplitude=multiplication)
amp_45 = Amplitude(Vector=eval_47.Tangent, Amplitude=multiplication)
amp_46 = Amplitude(Vector=eval_48.Tangent, Amplitude=multiplication)
bzspan_22 = BezierSpan(StartPoint=end_30.End, StartTangent=amp_44, EndPoint=end_31.End, EndTangent=amp_45)  # -> Curve, Length, Domain
bzspan_23 = BezierSpan(StartPoint=end_19.End, StartTangent=amp_17, EndPoint=end_32.End, EndTangent=amp_46)  # -> Curve, Length, Domain
series_2 = Series(Start=material_thickness, Step=material_thickness, Count=int)
mirror_2 = Mirror(Geometry=join_4, Plane=yz_14)  # -> Geometry, Transform
series_3 = Series(Start=0, Step=num_2, Count=multiplication_2)
mirror_3 = Mirror(Geometry=join_3, Plane=yz_14)  # -> Geometry, Transform
X_3 = UnitX(Factor=series_2)
X_4 = UnitX(Factor=series_3)
loft_2 = Loft(
    Section=[join_3, join_5, mirror_3.Geometry],
    Options={Adjust=False, Closed=False, Rebuild=10, Refit=0.01, LoftType=0, LoftEnds=0, LoftSimp=0})
move_9 = Move(Geometry=yz_14, Translation=X_3)  # -> Geometry, Transform
loft_3 = Loft(
    Section=[join_4, join_6, mirror_2.Geometry],
    Options={Adjust=False, Closed=False, Rebuild=10, Refit=0.01, LoftType=0, LoftEnds=0, LoftSimp=0})
move_10 = Move(Geometry=yz_14, Translation=X_4)  # -> Geometry, Transform
join_9 = JoinCurves(
    Curves=flatten([bzspan_12.Curve, bzspan_3.Curve, item_8, bzspan_15.Curve, bzspan_21.Curve, bzspan_19.Curve, item_37, item_42, crv_26, crv_27, crv_13, ln_18, bzspan_23.Curve, bzspan_22.Curve]),
    Preserve=False)
sec_2 = BrepPlane(Brep=loft_2, Plane=move_9.Geometry)  # -> Curves, Points
sec_3 = BrepPlane(Brep=loft_3, Plane=move_10.Geometry)  # -> Curves, Points
sec_4 = BrepPlane(Brep=loft_3, Plane=move_9.Geometry)  # -> Curves, Points
join_10 = JoinCurves(
    Curves=flatten([bzspan_11.Curve, bzspan_2.Curve, item_6, bzspan_14.Curve, bzspan_20.Curve, bzspan_18.Curve, item_35, item_39, fillet_2]),
    Preserve=False)
join_11 = JoinCurves(
    Curves=flatten([bzspan_10.Curve, bzspan.Curve, item_2, bzspan_13.Curve, bzspan_17.Curve, bzspan_16.Curve, item_31, item_34, fillet]),
    Preserve=False)
int_2 = Integer(seat_resolution)
subtraction = Subtraction(A=int, B=3)
series_4 = Series(Start=0, Step=1, Count=subtraction)
item_43 = ListItem(List=flatten(sec_2.Curves), Index=series_4, Wrap=False)
subtraction_2 = Subtraction(A=int_2, B=1)
division_4 = Division(A=seat_thickness, B=2)
yz_27 = YZPlane(Origin=Point(0, 0, 0))
rev_39 = ReverseList(List=series_3)
seat_lines = Curve(item_43)
leg_lines = Curve([join_9, join_10, join_11])
subtraction_3 = Subtraction(A=multiplication_3, B=num_2)
offset_10 = Offset(Curve=sec_4.Curves, Distance=division_4, Plane=yz_27, Corners=1)
X_5 = UnitX(Factor=rev_39)
X_6 = UnitX(Factor=subtraction_3)
cutting_lines = Curve([seat_lines, leg_lines])
planar = PlanarSrf(Edges=cutting_lines)
crv_28 = Curve(offset_10)
item_44 = ListItem(List=flatten(crv_28), Index=0, Wrap=False)
len = Length(Curve=item_44)
division_5 = Division(A=len, B=Slider(6, range=2..10))
int_3 = Integer(division_5)
move_11 = Move(Geometry=graft(sec_3.Curves), Translation=graft(X_5))  # -> Geometry, Transform
lng = ListLength(List=crv_28)
division_6 = Division(A=int_3, B=2)
rev_40 = Reverse(Vector=X_6)
mirror_4 = Mirror(Geometry=cutting_lines, Plane=yz_14)  # -> Geometry, Transform
subtraction_4 = Subtraction(A=division_6, B=0.1)
move_12 = Move(Geometry=move_11.Geometry, Translation=rev_40)  # -> Geometry, Transform
neg_6 = Negative(Input=material_thickness)
lng_2 = ListLength(List=flatten(crv_28))
crv_29 = Curve(item_33)
int_4 = Integer(subtraction_4)
X_7 = UnitX(Factor=neg_6)
extr = Extrude(Base=cutting_lines, Direction=X_7)
cap = CapHoles(Brep=extr)
shift = ShiftList(List=flatten(move_12.Geometry), Shift=1, Wrap=True)
multiplication_29 = Multiplication(A=int_4, B=2)
int_5 = Integer(multiplication_29)
divide = DivideCurve(Curve=crv_28, Number=int_5, Kinks=False)  # -> Points, Tangents, Parameters
division_7 = Division(A=int_5, B=2)
addition_2 = Addition(A=int_5, B=2)
mirror_5 = Mirror(Geometry=cap, Plane=yz_14)  # -> Geometry, Transform
addition_3 = Addition(A=int_5, B=2)
end_36 = EndPoints(Curve=item_32)  # -> Start, End
culln = CullNth(List=flatten(shift), CullFrequency=int_2)
end_37 = EndPoints(Curve=crv_29)  # -> Start, End
crv_cp_29 = CurveCP(Point=end_37.End, Curve=crv_29)  # -> Point, Parameter, Distance
neg_7 = Negative(Input=division_4)
subtraction_5 = Subtraction(A=int_5, B=1)
crv_30 = Curve(ln_5)
end_38 = EndPoints(Curve=item_19)  # -> Start, End
end_39 = EndPoints(Curve=item)  # -> Start, End
eval_49 = EvaluateCurve(Curve=crv_29, Parameter=crv_cp_29.Parameter)  # -> Point, Tangent, Length
series_5 = Series(Start=1, Step=addition_2, Count=lng_2)
lng_3 = ListLength(List=culln)
ln_23 = Line(PointA=end_30.End, PointB=end_31.End)
series_6 = Series(Start=division_7, Step=addition_3, Count=lng_2)
offset_11 = Offset(Curve=crv_30, Distance=neg_7, Plane=yz_27, Corners=1)
mesh = MeshBrep(
    Brep=[cap, mirror_5.Geometry],
    Settings={Refine=True, JaggedSeams=False, SimplePlanes=True, GridMinCount=16, GridMaxCount=0, Tolerance=0, RefineAngle=0, MinTolerance=0, RelativeTolerance=0.65, MinEdgeLength=0.0001, MaxEdgeLength=0})  # disabled
series_7 = Series(Start=subtraction_5, Step=int_5, Count=lng_2)
ln_24 = Line(PointA=end_39.Start, PointB=end_38.Start)
ln_25 = Line(PointA=end_37.End, PointB=end_36.End)
ln_26 = Line(PointA=end_39.End, PointB=end_38.End)
ln_27 = Line(PointA=end_37.Start, PointB=end_36.Start)
num_3 = Number(material_thickness)
amp_47 = Amplitude(Vector=eval_49.Tangent, Amplitude=num_3)
division_8 = Division(A=lng_3, B=subtraction_2)
end_40 = EndPoints(Curve=offset_11)  # -> Start, End
divide_2 = DivideCurve(Curve=ln_24, Number=2, Kinks=False)  # -> Points, Tangents, Parameters
divide_3 = DivideCurve(Curve=ln_26, Number=2, Kinks=False)  # -> Points, Tangents, Parameters
divide_4 = DivideCurve(Curve=ln_27, Number=2, Kinks=False)  # -> Points, Tangents, Parameters
divide_5 = DivideCurve(Curve=ln_25, Number=2, Kinks=False)  # -> Points, Tangents, Parameters
item_45 = ListItem(List=flatten(divide.Points), Index=series_5, Wrap=False)
item_46 = ListItem(List=flatten(divide.Points), Index=series_6, Wrap=False)
item_47 = ListItem(List=flatten(divide.Points), Index=series_7, Wrap=False)
rev_41 = Reverse(Vector=amp_47)
series_8 = Series(Start=nesting_distance, Step=0, Count=subtraction_2)
divide_6 = DivideCurve(Curve=ln_23, Number=2, Kinks=False)  # -> Points, Tangents, Parameters
pt_3 = Point(end_40.End)
series_9 = Series(Start=material_thickness, Step=material_thickness, Count=division_8)
item_48 = ListItem(List=divide_3.Points, Index=1, Wrap=False)
item_49 = ListItem(List=divide_2.Points, Index=1, Wrap=False)
item_50 = ListItem(List=divide_5.Points, Index=1, Wrap=False)
item_51 = ListItem(List=divide_4.Points, Index=1, Wrap=False)
Z = UnitZ(Factor=num_3)
series_10 = Series(Start=nesting_distance, Step=nesting_distance, Count=division_8)
yz_28 = YZPlane(Origin=pt_3)
X_8 = UnitX(Factor=num_3)
series_11 = Series(Start=series_8, Step=nesting_distance, Count=division_8)
item_52 = ListItem(List=divide_6.Points, Index=1, Wrap=False)
move_13 = Move(Geometry=item_48, Translation=Z)  # -> Geometry, Transform
move_14 = Move(Geometry=item_50, Translation=rev_41)  # -> Geometry, Transform
X_9 = UnitX(Factor=series_9)
slider = Slider(1, range=0..20)
slider_2 = Slider(0, range=0..20)
Y_4 = UnitY(Factor=series_10)
sort = SortList(Keys=flatten(series_11))  # -> List, ValuesA
cir_18 = Circle(Plane=yz_28, Radius=screw_hole_radius)
move_15 = Move(Geometry=cir_18, Translation=X_8)  # -> Geometry, Transform
rev_42 = Reverse(Vector=X_9)
neg_8 = Negative(Input=material_thickness)
yz_29 = YZPlane(Origin=move_13.Geometry)
yz_30 = YZPlane(Origin=item_49)
yz_31 = YZPlane(Origin=move_14.Geometry)
rev_43 = Reverse(Vector=X_8)
rev_44 = ReverseList(List=item_45)
yz_32 = YZPlane(Origin=item_51)
rev_45 = Reverse(Vector=X_8)
cull_i = CullIndex(List=item_45, Indices=0, Wrap=False)
cull_i_2 = CullIndex(List=item_46, Indices=0, Wrap=False)
cull_i_3 = CullIndex(List=item_47, Indices=0, Wrap=False)
Y_5 = UnitY(Factor=sort.List)
yz_33 = YZPlane(Origin=item_52)
move_16 = Move(Geometry=cutting_lines, Translation=rev_42)  # -> Geometry, Transform
cir_19 = Circle(Plane=yz_29, Radius=screw_hole_radius)
move_17 = Move(Geometry=cir_19, Translation=rev_43)  # -> Geometry, Transform
cir_20 = Circle(Plane=yz_30, Radius=screw_hole_radius)
move_18 = Move(Geometry=cir_20, Translation=rev_43)  # -> Geometry, Transform
rev_46 = ReverseList(List=cull_i)
cir_21 = Circle(Plane=yz_31, Radius=screw_hole_radius)
move_19 = Move(Geometry=cir_21, Translation=rev_45)  # -> Geometry, Transform
cir_22 = Circle(Plane=yz_32, Radius=screw_hole_radius)
move_20 = Move(Geometry=cir_22, Translation=rev_45)  # -> Geometry, Transform
X_10 = UnitX(Factor=neg_8)
cull_i_4 = CullIndex(List=rev_44, Indices=[slider_2, slider], Wrap=False)
cull_i_5 = CullIndex(List=rev_46, Indices=[slider_2, slider], Wrap=False)
cir_23 = Circle(Plane=yz_33, Radius=screw_hole_radius)
move_21 = Move(Geometry=cir_23, Translation=X_8)  # -> Geometry, Transform
yz_34 = YZPlane(Origin=cull_i_5)
move_22 = Move(Geometry=culln, Translation=Y_5)  # -> Geometry, Transform
yz_35 = YZPlane(Origin=cull_i_2)
yz_36 = YZPlane(Origin=cull_i_3)
yz_37 = YZPlane(Origin=cull_i_4)
yz_38 = YZPlane(Origin=item_47)
yz_39 = YZPlane(Origin=item_46)
move_23 = Move(Geometry=yz_34, Translation=X_10)  # -> Geometry, Transform
move_24 = Move(Geometry=move_16.Geometry, Translation=Y_4)  # -> Geometry, Transform
move_25 = Move(Geometry=yz_36, Translation=X_10)  # -> Geometry, Transform
move_26 = Move(Geometry=yz_35, Translation=X_10)  # -> Geometry, Transform
division_9 = Division(A=milling_bit_diameter, B=2)
cir_24 = Circle(Plane=move_23.Geometry, Radius=screw_hole_radius)
yz_40 = YZPlane(Origin=Point(0, 0, 0))
cir_25 = Circle(Plane=yz_39, Radius=screw_hole_radius)
cir_26 = Circle(Plane=yz_38, Radius=screw_hole_radius)
neg_9 = Negative(Input=division_9)
cir_27 = Circle(Plane=yz_37, Radius=screw_hole_radius)
cir_28 = Circle(Plane=move_26.Geometry, Radius=screw_hole_radius)
cir_29 = Circle(Plane=move_25.Geometry, Radius=screw_hole_radius)
rev_47 = ReverseList(List=cir_24)
offset_12 = Offset(Curve=move_22.Geometry, Distance=neg_9, Plane=yz_40, Corners=1)
rev_48 = ReverseList(List=cir_27)
screw_holes_layer_3 = Curve([cir_23, cir_18])
screw_holes_layer_1 = Curve([cir_21, cir_20, cir_19, cir_22])
screw_holes_layer_2 = Curve([move_17.Geometry, move_18.Geometry, move_19.Geometry, move_20.Geometry, move_21.Geometry, move_15.Geometry])
lng_4 = ListLength(List=cir_26)
lng_5 = ListLength(List=rev_48)
lng_6 = ListLength(List=cir_25)
lng_7 = ListLength(List=cir_28)
lng_8 = ListLength(List=rev_47)
lng_9 = ListLength(List=cir_29)
series_12 = Series(Start=1, Step=1, Count=lng_4)
series_13 = Series(Start=1, Step=1, Count=lng_5)
series_14 = Series(Start=1, Step=1, Count=lng_6)
series_15 = Series(Start=1, Step=1, Count=lng_7)
series_16 = Series(Start=1, Step=1, Count=lng_8)
series_17 = Series(Start=1, Step=1, Count=lng_9)
subtraction_6 = Subtraction(A=division_8, B=1)
subtraction_7 = Subtraction(A=division_8, B=2)
multiplication_30 = Multiplication(A=series_12, B=num_3)
multiplication_31 = Multiplication(A=series_13, B=num_3)
multiplication_32 = Multiplication(A=series_14, B=num_3)
multiplication_33 = Multiplication(A=series_15, B=num_3)
multiplication_34 = Multiplication(A=series_16, B=num_3)
multiplication_35 = Multiplication(A=series_17, B=num_3)
multiplication_36 = Multiplication(A=num_3, B=division_8)
multiplication_37 = Multiplication(A=nesting_distance, B=division_8)
multiplication_38 = Multiplication(A=num_3, B=subtraction_6)
multiplication_39 = Multiplication(A=nesting_distance, B=subtraction_6)
multiplication_40 = Multiplication(A=num_3, B=subtraction_7)
multiplication_41 = Multiplication(A=nesting_distance, B=subtraction_7)
X_11 = UnitX(Factor=multiplication_30)
X_12 = UnitX(Factor=multiplication_31)
X_13 = UnitX(Factor=multiplication_32)
X_14 = UnitX(Factor=multiplication_33)
X_15 = UnitX(Factor=multiplication_34)
X_16 = UnitX(Factor=multiplication_35)
X_17 = UnitX(Factor=multiplication_36)
Y_6 = UnitY(Factor=multiplication_37)
rev_49 = Reverse(Vector=X_11)
X_18 = UnitX(Factor=multiplication_38)
Y_7 = UnitY(Factor=multiplication_39)
rev_50 = Reverse(Vector=X_12)
rev_51 = Reverse(Vector=X_13)
X_19 = UnitX(Factor=multiplication_40)
Y_8 = UnitY(Factor=multiplication_41)
rev_52 = Reverse(Vector=X_14)
rev_53 = Reverse(Vector=X_15)
rev_54 = Reverse(Vector=X_16)
rev_55 = Reverse(Vector=X_17)
rev_56 = Reverse(Vector=X_18)
rev_57 = Reverse(Vector=X_19)
move_27 = Move(Geometry=cir_26, Translation=rev_49)  # -> Geometry, Transform
move_28 = Move(Geometry=rev_48, Translation=rev_50)  # -> Geometry, Transform
move_29 = Move(Geometry=cir_25, Translation=rev_51)  # -> Geometry, Transform
move_30 = Move(Geometry=cir_28, Translation=rev_52)  # -> Geometry, Transform
move_31 = Move(Geometry=rev_47, Translation=rev_53)  # -> Geometry, Transform
move_32 = Move(Geometry=cir_29, Translation=rev_54)  # -> Geometry, Transform
move_33 = Move(Geometry=screw_holes_layer_1, Translation=rev_55)  # -> Geometry, Transform
series_18 = Series(Start=1, Step=1, Count=lng_4)
move_34 = Move(Geometry=screw_holes_layer_2, Translation=rev_56)  # -> Geometry, Transform
series_19 = Series(Start=1, Step=1, Count=lng_5)
series_20 = Series(Start=1, Step=1, Count=lng_6)
move_35 = Move(Geometry=screw_holes_layer_3, Translation=rev_57)  # -> Geometry, Transform
series_21 = Series(Start=1, Step=1, Count=lng_7)
series_22 = Series(Start=1, Step=1, Count=lng_8)
series_23 = Series(Start=1, Step=1, Count=lng_9)
multiplication_42 = Multiplication(A=series_18, B=nesting_distance)
multiplication_43 = Multiplication(A=series_19, B=nesting_distance)
multiplication_44 = Multiplication(A=series_20, B=nesting_distance)
multiplication_45 = Multiplication(A=series_21, B=nesting_distance)
multiplication_46 = Multiplication(A=series_22, B=nesting_distance)
multiplication_47 = Multiplication(A=series_23, B=nesting_distance)
move_36 = Move(Geometry=move_33.Geometry, Translation=Y_6)  # -> Geometry, Transform
move_37 = Move(Geometry=move_34.Geometry, Translation=Y_7)  # -> Geometry, Transform
move_38 = Move(Geometry=move_35.Geometry, Translation=Y_8)  # -> Geometry, Transform
Y_9 = UnitY(Factor=multiplication_42)
Y_10 = UnitY(Factor=multiplication_43)
Y_11 = UnitY(Factor=multiplication_44)
Y_12 = UnitY(Factor=multiplication_45)
Y_13 = UnitY(Factor=multiplication_46)
Y_14 = UnitY(Factor=multiplication_47)
move_39 = Move(Geometry=move_27.Geometry, Translation=Y_9)  # -> Geometry, Transform
move_40 = Move(Geometry=move_29.Geometry, Translation=Y_11)  # -> Geometry, Transform
move_41 = Move(Geometry=move_28.Geometry, Translation=Y_10)  # -> Geometry, Transform
move_42 = Move(Geometry=move_32.Geometry, Translation=Y_14)  # -> Geometry, Transform
move_43 = Move(Geometry=move_30.Geometry, Translation=Y_12)  # -> Geometry, Transform
move_44 = Move(Geometry=move_31.Geometry, Translation=Y_13)  # -> Geometry, Transform
trim_line_picker = Slider(0, range=0..10)
series_24 = Series(Start=trim_line_picker, Step=subtraction_2, Count=division_8)
nested_trim_lines_all_levels_for_preview = Curve(offset_12)
item_53 = ListItem(List=flatten(offset_12), Index=series_24, Wrap=False)
nested_cutting_lines = Curve(move_24.Geometry)
# Bake cnc milling lines here:
nested_screw_holes = Curve([move_44.Geometry, move_43.Geometry, move_42.Geometry, move_41.Geometry, move_40.Geometry, move_39.Geometry, move_38.Geometry, move_37.Geometry, move_36.Geometry])
_3d_preview = Brep([mirror_5.Geometry, cap])
trim_line_grouped = Group(Objects=item_53)
preview = CustomPreview(
    Geometry=nested_trim_lines_all_levels_for_preview,
    Shader={diffuse=RGB(255, 105, 180), ambient=RGB(0, 0, 0), emission=RGB(76, 32, 54), specular=RGB(255, 255, 255), shine=0.5, transparency=0})
